# Grasshopper definition Dashboard Part 6.gh (Grasshopper 1.0.7)
# plug-ins: MeshEdit Components, Human UI, Human, FalseStartToggle, Wombat

# HMC ARCHITECTS -
# DIGITAL PRACTICE
# PROJECT INFO
# <PROJECT NO.>
# <PROJECT NAME>
plugins_used = Panel("Wombat")
# < Click Here to Launch HUD
# CREATED BY: <NAME SURNAME>
# CREATED: <YYYY/MM/DD>
# OFFICE LOCATION: <CITY, STATE>
# 
# VERSION <0.X>
# LAST EDITED: <YYYY/MM/DD>
# 
# 
# PLUGINS:
# <PLUGINS>
# 
# NOTES:
# <NOTES>
# DESIGNER'S
# GUIDELINES
# DESIGNER'S GUIDELINES
# 
# 1. DIVIDE THE GRASSHOPPER DEFINITION INTO THE USER INTERFACE AND THE BACK-END
# 
# 2. BUILD THE DEFINITION WITH SMALL BLOCKS
# 
# 3. BLOCKS SHOULD ALWAYS HAVE INPUT/OUTPUT
# 
# 4. RENAME INPUT/OUTPUT CONTAINERS TO DATA THEY CARRY
# 
# 5. COLOR-CODE BLOCKS ACCORDING TO THE TEMPLATE
toggle = FalseStartToggle(True)

# ---- group: Launch Browser to .EPW Map
button = CreateButton(ButtonName="Click here to search for your .EPW file.", ButtonStyle=1)
values = ValueListener(Elements=button, SomeProperty=True)  # -> Values, Indices
downloadepw = Ladybug_downloadEPWWeatherFile(download=values.Values)  # -> readMe; plug-in component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

# ---- group: .EPW Text Field
panel = Panel("Copy .EPW file link here - Update field by clicking button >")
textbox = CreateTextBox(DefaultText=panel, UpdateButton=True, showLabel=True)
values_2 = ValueListener(Elements=textbox, SomeProperty=True)  # -> Values, Indices

# ---- group: Chart Types
panel_2 = Panel("""Comfort Hours
Hourly Temp""")
panel_3 = Panel("""Wind Rose
Sun Chart""")
checklist = CreateChecklist(ChecklistItems=panel_2, Selected=False)
checklist_2 = CreateChecklist(ChecklistItems=panel_3, Selected=False)
stack = CreateStack(UIElements=[checklist, checklist_2], Horizontal=True)
values_3 = ValueListener(Elements=stack, SomeProperty=True)  # -> flatten(Values), Indices
expander = CreateExpander(UIElements=stack, Open=True)

# ---- group: North Adjustment
north_adjustment = Slider(0, range=0..360)
slider = CreateSlider(Slider=north_adjustment, ShowBounds=False, ShowTicks=False, ShowTooltip=False, ShowValLabel=True, showLabel=True)
values_4 = ValueListener(Elements=slider, SomeProperty=True)  # -> Values, Indices

# ---- group: End Data
panel_4 = Panel("""Jan
Feb
Mar
Apr
May
Jun
Jul
Aug
Sept
Oct
Nov
Dec""")
series = Series(Start=1, Step=1, Count="31")
series_2 = Series(Start=1, Step=1, Count="24")
pulldown = CreatePulldownMenu(Label="End Month", ListItems=panel_4, SelectedIndex=11, showLabel=True)
pulldown_2 = CreatePulldownMenu(Label="Day", ListItems=series, SelectedIndex=30, showLabel=True)
pulldown_3 = CreatePulldownMenu(Label="Hours", ListItems=series_2, SelectedIndex=23, showLabel=True)
values_5 = ValueListener(Elements=pulldown, SomeProperty=True)  # -> Values, expr("x+1", Indices)
values_6 = ValueListener(Elements=pulldown_2, SomeProperty=True)  # -> Values, Indices
values_7 = ValueListener(Elements=pulldown_3, SomeProperty=True)  # -> Values, Indices

# ---- group: Select Temperature Units
panel_5 = Panel("""Fahrenheit
Celsius""")
pulldown_4 = CreatePulldownMenu(Label="Select Temperature Units", ListItems=panel_5, SelectedIndex=0, showLabel=True)
values_8 = ValueListener(Elements=pulldown_4, SomeProperty=True)  # -> Values, Indices

# ---- group: Start Data
panel_6 = Panel("""Jan
Feb
Mar
Apr
May
Jun
Jul
Aug
Sept
Oct
Nov
Dec""")
series_3 = Series(Start=1, Step=1, Count="31")
series_4 = Series(Start=1, Step=1, Count="24")
pulldown_5 = CreatePulldownMenu(Label="Start Month", ListItems=panel_6, showLabel=True)
pulldown_6 = CreatePulldownMenu(Label="Day", ListItems=series_3, showLabel=True)
pulldown_7 = CreatePulldownMenu(Label="Hours", ListItems=series_4, showLabel=True)
values_9 = ValueListener(Elements=pulldown_5, SomeProperty=True)  # -> Values, expr("x+1", Indices)
values_10 = ValueListener(Elements=pulldown_6, SomeProperty=True)  # -> Values, Indices
values_11 = ValueListener(Elements=pulldown_7, SomeProperty=True)  # -> Values, Indices

# ----
path = FilePath("U:\Staff\NKelly\HMC Architects_TypeLogo2016_black.png")
image = CreateImage(ImageSource=path, ImageWidth=150)

# ---- group: Warning Indication
sort = SortList(Keys=values_3.Values)  # -> reverse(Keys), ValuesA
item = ListItem(List=sort.Keys, Index=0, Wrap=False)
filter = StreamFilter(Gate=item, Stream0="Chart Types (NONE SELECTED)", Stream1="Chart Types")
filter_2 = StreamFilter(Gate=item, Stream0=ColourSwatch(SwatchColor=RGB(255, 196, 0)), Stream1=ColourSwatch(SwatchColor=RGB(144, 185, 209)))
setexp = SetExpander(Expander=expander, Name=filter)
adjustelem = AdjustElementAppearance(ElementsToAdjust=expander, Foreground=RGB(0, 0, 0), Background=filter_2)

# ---- group: Analysis Options
expander_2 = CreateExpander(UIElements=[slider, pulldown_4], Header="ANALYSIS SETTINGS", Open=True)
adjustelem_2 = AdjustElementAppearance(ElementsToAdjust=expander_2, Foreground=RGB(0, 0, 0), Background=ColourSwatch(SwatchColor=RGB(144, 185, 209)))

# ---- group: List Sorting
rep = ReplaceText(Text=values_8.Values, Find="Fahrenheit", Replace="0", RecursiveReplace=False)
rep_2 = ReplaceText(Text=values_8.Values, Find="Celsius", Replace="1", RecursiveReplace=False)
sort_2 = SortList(Keys=flatten([rep, rep_2]))  # -> reverse(Keys), ValuesA
item_2 = ListItem(List=sort_2.Keys, Index=0, Wrap=False)

# ----
launchwin = LaunchWindow(Show=toggle, Name="Evnvironmental Dash", Width=415, Height=528, ChildStatus=0, EnableHorizScroll=False)
stack_2 = CreateStack(UIElements=flatten([pulldown_5, pulldown_6, pulldown_7]), Horizontal=True)
stack_3 = CreateStack(UIElements=flatten([pulldown, pulldown_2, pulldown_3]), Horizontal=True)
analysisperiod = Ladybug_AnalysisPeriod(
    fromMonth=values_9.Indices,
    fromDay=values_10.Values,
    fromHour=values_11.Values,
    toMonth=values_5.Indices,
    toDay=values_6.Values,
    toHour=values_7.Values)  # -> readMe, analysisPeriod; plug-in component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
# All work is protected under the Creative Commons Attribution-Noncommercial-Share Alike 3.0 United States license
# LEGEND
# USE:
# 
# FOR INCOMING REFERENCES SUCH AS FILEPATHS AND GEOMETRIES
epw_stat = Ladybug_OpenEPWAndSTATWeatherFiles(weatherFileURL=values_2.Values)  # -> epwFile, statFile; plug-in component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
accent_colors = ValueList({"Amber", "Blue", "Brown", "Cobalt", "Crimson", "Cyan", "Emerald", "Green", "Indigo", "Lime", "Magenta", "Mauve", "Olive", "Orange", "Pink", "Purple", "Red", "Sienna", "Steel", "Taupe", "Teal", "Violet", "Yellow"}, selected="Blue")
null = NullItem(Item=analysisperiod.analysisPeriod)  # -> NullFlags, InvalidFlags, Description
expander_3 = CreateExpander(UIElements=[button, textbox], Header=".EPW Weather File Download", Open=True)

# ---- group: Error Reporting
tmatch = MatchText(Text=values_2.Values, Pattern=panel, Case=True)
filter_3 = StreamFilter(Gate=tmatch, Stream0=ColourSwatch(SwatchColor=RGB(144, 185, 209)), Stream1=ColourSwatch(SwatchColor=RGB(255, 196, 0)))
filter_4 = StreamFilter(Gate=tmatch, Stream0="LOAD .EPW FILE", Stream1="LOAD .EPW FILE (.EPW FILE NOT FOUND)")
setexp_2 = SetExpander(Expander=expander_3, Name=filter_4)
adjustelem_3 = AdjustElementAppearance(ElementsToAdjust=expander_3, Foreground=RGB(0, 0, 0), Background=filter_3)

# ----
split = SplitList(List=null.NullFlags, Index=1)  # -> ListA, ListB

# ---- group: Error Reporting
filter_5 = StreamFilter(Gate=split.ListA, Stream0=ColourSwatch(SwatchColor=RGB(144, 185, 209)), Stream1=ColourSwatch(SwatchColor=RGB(255, 0, 0)))
filter_6 = StreamFilter(Gate=split.ListA, Stream0="Analysis Period", Stream1="Analysis Period (ERROR)")

# ----
winprops = SetWindowProperties(
    Window=launchwin,
    AccentColor=accent_colors,
    ShowTitleBar=True,
    BackgroundColor=ColourSwatch(SwatchColor=RGB(227, 227, 227)),
    ScaleFactor=1)

# ---- group: DESIGN
# UTILITY
# USE:
# 
# FOR THE USE OF INPUT, EG SLIDERS, NUMBERS, ETC.
# USE:
# 
# FOR CANVAS/CABLE MANAGMENT
panel_7 = Panel("""USE:

BACK-END FUNCTIONALITY""")

# ----
expander_4 = CreateExpander(UIElements=flatten([stack_2, stack_3]), Open=True)
setexp_3 = SetExpander(Expander=expander_4, Name=filter_6)
adjustelem_4 = AdjustElementAppearance(ElementsToAdjust=expander_4, Foreground=RGB(0, 0, 0), Background=filter_5)
# USE:
# 
# "WORK IN PROGRESS"
# USE:
# 
# FOR BLOCKS TO BAKE GEOMETRY
# USE:
# 
# FOR VIEWING TEXT/GEOMETRY IN THE RHINO VIEWPORT
importepw = Ladybug_ImportEpw(epwFile=epw_stat.epwFile)  # -> readMe, latitude, location, dryBulbTemperature, dewPointTemperature, relativeHumidity, windSpeed, windDirection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; plug-in component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
c2f = Ladybug_C2F(C=importepw.dryBulbTemperature)  # -> F; plug-in component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
addelems = AddElements(Window=launchwin, Elements=flatten([image, expander_3, expander_4, expander_2, expander]), DoVLChecking=True)  # -> AddedElements, ElementNames
filter_7 = StreamFilter(Gate=item_2, Stream0=c2f, Stream1=importepw.dryBulbTemperature)
c_f_temp = Panel(filter_7)
north_adjustment_2 = Panel(values_4.Values)
# Chart Types: Comfort Hours
# Hourly Temp
# Wind Rose
# Sun Chart
chart_types = Panel(values_3.Values)
analysis_period = Panel(analysisperiod.analysisPeriod)
ladybug = Ladybug_Ladybug()  # -> Vviiiiiiiiiizzz; plug-in component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

# ---- group: Chart Types
# Chart Types: Comfort Hours
# Hourly Temp
# Wind Rose
# Sun Chart
chart_types_2 = ListItem(List=values_3.Values, Index=0, Wrap=True)  # -> Item, Item1, Item2, Item3

# ----
filter_8 = StreamFilter(Gate=chart_types_2.Item, Stream1=filter_7)

# ---- group: Monthly Average Temps Chart
# Monthly Average Hourly Temps Chart
panel_8 = Panel("13")
gradientlibrary = Ladybug_GradientLibrary(gradIndex=panel_8)  # -> customColors; plug-in component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
selectandaveragedata = Ladybug_AverageData(annualHourlyData=filter_7, analysisPeriod=analysisperiod.analysisPeriod)  # -> readMe, selHourlyData, averagedDaily, averagedMonthly, avrMonthlyPerHour, avrMonthlyMinPerHour, avrMonthlyMaxPerHour; plug-in component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
legendpar = Ladybug_LegendParameters(customColors=flatten(gradientlibrary), decimalPlaces="0")  # -> legendPar; plug-in component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
pt = ConstructPoint(XCoordinate=0, YCoordinate=Slider(3200, range=0..10000), ZCoordinate=0)
filter_9 = StreamFilter(Gate=chart_types_2.Item1, Stream1=selectandaveragedata.avrMonthlyPerHour)
_3dchart = Ladybug_3DChart(inputData=flatten(filter_9), basePoint=pt, xScale=".25", zScale="0", legendPar=legendpar)  # -> readMe, graphMesh, graphCurves, legend, legendBasePts, title, titleBasePts, dataPts, conditionalHOY; plug-in component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

# ---- group: Parse into Monthly Data
strnum = Ladybug_SeparateData(inputList=filter_8)  # -> numbers, strings; plug-in component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
branchdatadailymonthlyhourly = Ladybug_BranchData(data=strnum.numbers)  # -> dataEachDayOfYear, dataEachMonth, dataEachHourOfDay; plug-in component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

# ---- group: Comfort Temp Range
comfort_high = Slider(75, range=50..90)
comfort_low = Slider(68, range=50..90)

# ----
# Wind Rose with Temps Chart
number_slider = Slider(2100, range=0..10000)
toggle_2 = FalseStartToggle(False)
pt_2 = ConstructPoint(XCoordinate=0, YCoordinate=number_slider, ZCoordinate=0)
windrose = Ladybug_WindRose(
    north=values_4.Values,
    hourlyWindDirection=importepw.windDirection,
    hourlyWindSpeed=importepw.windSpeed,
    annualHourlyData=flatten(filter_7),
    analysisPeriod=analysisperiod.analysisPeriod,
    centerPoint=pt_2,
    showAverageVelocity=toggle_2,
    scale=".75",
    runIt=chart_types_2.Item2)  # -> readMe, calmRoseMesh, windRoseMesh, windRoseCrvs, windRoseCenPts, legend, legendBasePts, title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; plug-in component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

filter_10 = StreamFilter(Gate=chart_types_2.Item3, Stream1=importepw.location)
# Sun Chart
sunpath = Ladybug_SunPath(
    location=filter_10,
    hour=12,
    day=21,
    month=12,
    timeStep=1,
    analysisPeriod=analysisperiod.analysisPeriod,
    projection=Slider(2, range=0..2),
    dailyOrAnnualSunPath=True)  # -> readMe, sunVectors, sunAltitudes, sunAzimuths, port, sunSpheresMesh, sunPathCrvs, compassCrvs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; plug-in component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

# ---- group: Data Header
item_3 = ListItem(List=strnum.strings, Index="1", Wrap=True)
createheader = Ladybug_CreateLBHeader(location=item_3, dataType="Hours of Comfort", units="Hours", timeStep="Monthly")  # -> flatten(LBHeader), dataWithHeader; plug-in component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

# ----
viewer = ParamViewer(windrose.windRoseCrvs)
number_slider_2 = Slider(0.19, range=0..1)
branch = TreeBranch(Tree=windrose.windRoseMesh, Path="{1}", MaintainPaths=True)
branch_2 = TreeBranch(Tree=windrose.windRoseCrvs, Path="{1}", MaintainPaths=True)
branch_3 = TreeBranch(Tree=windrose.legend, Path="{1}", MaintainPaths=True)
branch_4 = TreeBranch(Tree=windrose.title, Path="{1}", MaintainPaths=True)
shift = ShiftList(List=sunpath.compassCrvs, Shift=Slider(15, range=0..100), Wrap=False)
shift_2 = ShiftList(List=sunpath.altitudeCrvs, Shift=Slider(10, range=0..100), Wrap=False)
crv = Curve(branch_2)
mesh = Mesh(branch_2)
mesh_2 = Mesh(branch)
mesh_3 = Mesh(branch_3)
shift_3 = ShiftList(List=reverse(branch_4), Shift=Slider(171, range=0..400), Wrap=False)
clean = CleanTree(RemoveNulls=True, RemoveInvalid=True, RemoveEmpty=False, Tree=crv)
clean_2 = CleanTree(RemoveNulls=True, RemoveInvalid=True, RemoveEmpty=False, Tree=mesh)
shift_4 = ShiftList(List=reverse(_3dchart.title), Shift=Slider(50, range=0..100), Wrap=False)
number_slider_3 = Slider(0.33, range=0..1)
pt_3 = ConstructPoint(XCoordinate=Slider(201, range=0..1000), YCoordinate=Slider(780, range=0..10000), ZCoordinate=Slider(1000, range=0..1000))
pt_4 = ConstructPoint(
    XCoordinate=Slider(1060, range=750..1250),
    YCoordinate=Slider(849, range=500..1000),
    ZCoordinate=Slider(1000, range=0..1000))
crvtoscreen = RenderCurveToScreen(
    Curve=[sunpath.compassCrvs, sunpath.sunPathCrvs, sunpath.altitudeCrvs],
    Location=pt_3,
    ScaleFactor=number_slider_2,
    Color=ColourSwatch(SwatchColor=RGB(64, 64, 64)),
    Thickness=1,
    Depth=0.95,
    Fixed=True,
    m_scWithvp=True)
meshtoscreen = RenderMeshToScreen(
    Mesh=[sunpath.sunSpheresMesh, shift, shift_2],
    Location=pt_3,
    ScaleFactor=number_slider_2,
    Depth=0.95,
    Fixed=True,
    m_scWithvp=True)
shift_5 = ShiftList(List=clean_2, Shift=Slider(14, range=0..50), Wrap=False)
pt_5 = ConstructPoint(XCoordinate=Slider(35, range=0..1000), YCoordinate=Slider(1528, range=0..10000), ZCoordinate=Slider(1000, range=0..1000))
meshtoscreen_2 = RenderMeshToScreen(
    Mesh=[_3dchart.graphMesh, _3dchart.legend, shift_4],
    Location=pt_5,
    ScaleFactor=Slider(0.38, range=0..1),
    Depth=0.95,
    Fixed=True,
    m_scWithvp=True)
crvtoscreen_2 = RenderCurveToScreen(
    Curve=clean,
    Location=pt_4,
    ScaleFactor=number_slider_3,
    Color=ColourSwatch(SwatchColor=RGB(64, 64, 64)),
    Thickness=1,
    Depth=0.95,
    Fixed=True,
    m_scWithvp=True)
meshtoscreen_3 = RenderMeshToScreen(
    Mesh=[mesh_2, mesh_3, shift_5, shift_3],
    Location=pt_4,
    ScaleFactor=number_slider_3,
    Depth=0.95,
    Fixed=True,
    m_scWithvp=True)
number_slider_4 = Slider(60, range=0..101)  # disabled
panel_9 = Panel("""False
False
True
False""")  # disabled
panel_10 = Panel("""True
False
False""")  # disabled
number_slider_5 = Slider(10, range=0..10)  # disabled
number_slider_6 = Slider(0.53, range=0..1)
pt_6 = ConstructPoint(
    XCoordinate=Slider(1162, range=750..1500),
    YCoordinate=Slider(968, range=0..10000),
    ZCoordinate=Slider(1000, range=0..1000))
number_slider_7 = Slider(0.46, range=0..1)
pt_7 = ConstructPoint(
    XCoordinate=Slider(1175, range=750..1500),
    YCoordinate=Slider(965, range=0..10000),
    ZCoordinate=Slider(10000, range=0..10000))

# ---- group: Too Hot
larger = LargerThan(FirstNumber=branchdatadailymonthlyhourly.dataEachMonth, SecondNumber=comfort_high)  # -> LargerThan, OrEqualTo
ma = MassAddition(Input=larger.LargerThan)  # -> Result, PartialResults

# ---- group: Hours Per Month
lng = ListLength(List=larger.LargerThan)
panel_11 = Panel(lng)

# ---- group: Comfortable
larger_2 = LargerThan(FirstNumber=branchdatadailymonthlyhourly.dataEachMonth, SecondNumber=comfort_low)  # -> LargerThan, OrEqualTo
smaller = SmallerThan(FirstNumber=branchdatadailymonthlyhourly.dataEachMonth, SecondNumber=comfort_high)  # -> SmallerThan, OrEqualTo
and = GateAnd(A=larger_2.OrEqualTo, B=smaller.OrEqualTo)
ma_2 = MassAddition(Input=and)  # -> Result, PartialResults

# ---- group: Too Cold
smaller_2 = SmallerThan(FirstNumber=branchdatadailymonthlyhourly.dataEachMonth, SecondNumber=comfort_low)  # -> SmallerThan, OrEqualTo
ma_3 = MassAddition(Input=smaller_2.SmallerThan)  # -> Result, PartialResults

# ----
# Monthly Comfort Hours Chart
division = Division(A=ma.Result, B=panel_11)
division_2 = Division(A=ma_2.Result, B=panel_11)
division_3 = Division(A=ma_3.Result, B=panel_11)
multiplication = Multiplication(A=division, B=100)
multiplication_2 = Multiplication(A=division_2, B=100)
multiplication_3 = Multiplication(A=division_3, B=100)

# ---- group: Comfortable (continued)
panel_12 = Panel(multiplication_2)

# ---- group: Too Hot (continued)
panel_13 = Panel(multiplication)

# ---- group: Too Cold (continued)
panel_14 = Panel(multiplication_3)

# ---- group: Add Header To Data
data = Data(flatten([createheader.LBHeader, panel_14]))
data_2 = Data(flatten([createheader.LBHeader, panel_12]))
data_3 = Data(flatten([createheader.LBHeader, panel_13]))

# ---- group: Monthly Temp Comfort Bar Chart
legendpar_2 = Ladybug_LegendParameters(
    customColors=flatten([ColourSwatch(SwatchColor=RGB(74, 140, 199)), ColourSwatch(SwatchColor=RGB(139, 222, 133)), ColourSwatch(SwatchColor=RGB(201, 74, 48))]),
    decimalPlaces="0")  # -> legendPar; plug-in component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
barchart = Ladybug_MonthlyBarChart(inputData=flatten([data, data_2, data_3]), stackValues=Toggle(True), xScale="10", yScale="10", legendPar=legendpar_2)  # -> readMe, dataMesh, dataCurves, dataCrvColors, graphAxes, graphLabels, title, titleBasePt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; plug-in component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

# ---- group: Data Labels
data_4 = Data(flatten(panel_13))
data_5 = Data(flatten(panel_12))
data_6 = Data(flatten(panel_14))
round = Round(Number=flatten([data_6, data_5, data_4]))  # -> Nearest, Floor, Ceiling
larger_3 = LargerThan(FirstNumber=round.Nearest, SecondNumber=0)  # -> flatten(LargerThan), OrEqualTo
cull = CullPattern(List=round.Nearest, CullPattern=larger_3.LargerThan)
cull_2 = CullPattern(List=flatten(barchart.dataMesh), CullPattern=larger_3.LargerThan)
facen = FaceNormals(Mesh=cull_2)  # -> flatten(Centers), Normals
concat = Concatenate(FragmentA=cull, FragmentB="%")
tag = TextTag3D(
    Location=facen.Centers,
    Text=flatten(concat),
    Size=Slider(11, range=0..15),
    Colour=ColourSwatch(SwatchColor=RGB(255, 255, 255)),
    Justification=5)

# ----
shift_6 = ShiftList(List=barchart.graphLabels, Shift=number_slider_4, Wrap=False)  # disabled

# ---- group: Scale/Move Labels
panel_15 = Panel("""False
True
False""")
shift_7 = ShiftList(List=reverse(barchart.graphLabels), Shift=Slider(65, range=0..101), Wrap=False)
cull_3 = CullPattern(List=shift_7, CullPattern=panel_15)
path_mapper = PathMapper(shift_7, source="{A;B;C;D} (i)", target="{Floor(i/ceiling(item_count/12))}")
area = MeshArea(Mesh=cull_3)  # -> Area, graft(Centroid)
scale = Scale(Geometry=path_mapper, Center=area.Centroid, Factor=Slider(18.6, range=0..20))  # -> Geometry, Transform
neg = Negative(Value=Slider(25, range=0..25))
Y = UnitY(Factor=neg)
move = Move(Geometry=scale.Geometry, Motion=Y)  # -> Geometry, Transform

# ----
mesh_4 = Mesh(barchart.dataMesh)
cull_4 = CullPattern(List=shift_6, CullPattern=panel_9)  # disabled
panel_16 = Panel(barchart.graphLabels)
path_mapper_2 = PathMapper(shift_6, source="{A;B;C;D} (i)", target="{Floor(i/ceiling(item_count/11))}")  # disabled
area_2 = MeshArea(Mesh=cull_4)  # -> Area, simplify(graft(Centroid)); disabled
prune = PruneTree(Tree=path_mapper_2, Minimum=2, Maximum=0)  # disabled
scale_2 = Scale(Geometry=prune, Center=area_2.Centroid, Factor=number_slider_5)  # -> Geometry, Transform; disabled
text2crv = TextOutlines(TextContent=concat, Plane=facen.Centers, Face="Arial", Size=12, Bold=False, Italics=False)  # -> TextCurves, TextBoundingBox
meshtoscreen_4 = RenderMeshToScreen(
    Mesh=[barchart.dataMesh, move.Geometry],
    Location=pt_6,
    ScaleFactor=number_slider_6,
    Depth=0.95,
    Fixed=True,
    m_scWithvp=True)
crvtoscreen_3 = RenderCurveToScreen(
    Curve=text2crv.TextCurves,
    Location=pt_7,
    ScaleFactor=number_slider_6,
    Color=ColourSwatch(SwatchColor=RGB(33, 33, 33)),
    Thickness=1,
    Depth=0.95,
    Fixed=True,
    m_scWithvp=True)
